# Grasshopper definition Robot Handwriting v_2-0-0 [May-17 '19, 1147].gh (Grasshopper 1.0.7)
# plug-ins: Robots, ghJSON, InteracTool, gHowl, MetaHopper

# ----
# Legend:
# Control
# List Management
# Geometry operations
# Robot Programming
# Configuration
# Canvas organisation
# Helper Functions
# PlugIns Used: InteracTool
# Robots 0.0.5
# MetaHopper 1.2.0
# All Components Used: DATE- 2019.05.02 TIME- 19:03h
# Last saved by - Robin
# Total Components - 383
# MetaHopper:
# ...Attributes:
# ......Set Sketch - 1
# ...Object Retrieval:
# ......Get Objects in Group - 1
# ......Get Groups - 1
# Vector:
# ...Plane:
# ......Align Plane - 1
# ......XY Plane - 2
# ......Flip Plane - 5
# ......Plane 3Pt - 1
# ......Deconstruct Plane - 1
# ......Plane Normal - 1
# ...Vector:
# ......Amplitude - 1
# ......Vector 2Pt - 1
# ...Point:
# ......Construct Point - 4
# Params:
# ...Util:
# ......Sketch - 1
# ......Relay - 2
# ......Cluster - 2
# ......Data Recorder - 2
# ......Scribble - 28
# ......Jump - 25
# ...Geometry:
# ......Plane - 24
# ......Vector - 2
# ......Mesh - 4
# ......Curve - 19
# ......Point - 23
# ......Rectangle - 9
# ...Primitive:
# ......Boolean - 10
# ......Integer - 9
# ......Text - 6
# ......Data - 1
# ......Number - 22
# ...Input:
# ......Control Knob - 1
# ......Value List - 2
# ......Panel - 59
# ......Button - 6
# ......Boolean Toggle - 9
# ......Number Slider - 12
# ......Font - 1
# Robots:
# ...Util:
# ......Simple trail - 1
# ...Parameters:
# ......Tool parameter - 1
# ......Program parameter - 1
# ...Components:
# ......Program simulation - 1
# ......Create program - 1
# ......Create tool - 1
# ......Check collisions - 1
# ......Remote Connection - 1
# ......Create target - 1
# ......Load robot system - 1
# Display:
# ...Interact:
# ......Mouse Event - 1
# Curve:
# ...Util:
# ......Reduce - 1
# ......Fillet - 1
# ......Explode - 1
# ......Curve To Polyline - 1
# ...Primitive:
# ......Rectangle 3Pt - 1
# ...Spline:
# ......Interpolate - 2
# ......PolyLine - 2
# ...Analysis:
# ......Control Points - 3
# ......Deconstuct Rectangle - 2
# Transform:
# ...Euclidean:
# ......Orient - 2
# ......Move - 1
# ...Affine:
# ......Scale - 1
# Maths:
# ...Operators:
# ......Division - 2
# ......Equality - 2
# ......Subtraction - 7
# ......Addition - 1
# ...Script:
# ......C# Script - 2
# ......Python Script - 1
# ......Evaluate - 3
# ...Domain:
# ......Consecutive Domains - 1
# ......Deconstruct Domain - 5
# OTools:
# ...3 | Debugging:
# ......OTools_GetComponents2 - 1
# Surface:
# ...Primitive:
# ......Bounding Box - 1
# Sets:
# ...Sequence:
# ......Series - 3
# ......Cull Pattern - 3
# ...List:
# ......Insert Items - 1
# ......Shift List - 1
# ......List Length - 6
# ......Dispatch - 1
# ......List Item - 4
# ......Partition List - 1
# ...Tree:
# ......Clean Tree - 1
# ......Merge - 2
# ......Tree Branch - 2
# ......Stream Filter - 2
# ......Tree Statistics - 1
# ...Sets:
# ......Member Index - 1
update_component_list = Button()
o_getcomps2 = OTools_GetComponents2(x=update_component_list)  # inputs x: Boolean; plug-in component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

subtraction = Subtraction(A="0", B="2")
panel = Panel(subtraction)

# ---- group: Sketch from text / Text
font = Font({"", "Arial", "Arial Black", "Bahnschrift", "Bahnschrift ...": "Bahnschrift Condensed", "Bahnschrift ...": "Bahnschrift Light", "Bahnschrift ...": "Bahnschrift Light Condensed", "Bahnschrift ...": "Bahnschrift Light SemiCondensed", "Bahnschrift ...": "Bahnschrift SemiBold", "Bahnschrift ...": "Bahnschrift SemiBold Condensed"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}, selected="Arial")  # disabled
bold = BooleanToggle(False)  # disabled
text_size = Slider(43.292, range=0.1..200)  # disabled
text_to_write = Panel("Hallo leute wie gehts ?")  # disabled
number = Number(text_size)  # disabled

# ---- group: Define Writing space / Top right
x_coordinate = Panel("670")
y_coordinate = Panel("-53")
z_coordinate = Panel("0")
construct_point = ConstructPoint(XCoordinate=x_coordinate, YCoordinate=y_coordinate, ZCoordinate=z_coordinate)
tr_point = Point(construct_point)

# ---- group: Define Writing space / Top left
# Define writing area
x_coordinate_2 = Panel("670")
y_coordinate_2 = Panel("-146")
z_coordinate_2 = Panel("0")
construct_point_2 = ConstructPoint(XCoordinate=x_coordinate_2, YCoordinate=y_coordinate_2, ZCoordinate=z_coordinate_2)
tl_point = Point(construct_point_2)

# ---- group: Define Writing space / bottom right
x_coordinate_3 = Panel("711")
z_coordinate_3 = Panel("0")
y_coordinate_3 = Panel("-53")
construct_point_3 = ConstructPoint(XCoordinate=x_coordinate_3, YCoordinate=y_coordinate_3, ZCoordinate=z_coordinate_3)
br_point = Point(construct_point_3)

# ---- group: Define Writing space / Top right
x_coordinate_4 = Panel("672")
y_coordinate_4 = Panel("142")
z_coordinate_4 = Panel(panel)
construct_point_4 = ConstructPoint(XCoordinate=x_coordinate_4, YCoordinate=y_coordinate_4, ZCoordinate=z_coordinate_4)
tr_point_2 = Point(construct_point_4)

# ---- group: Define Writing space / Top left
# Define writing area
x_coordinate_5 = Panel("672")
y_coordinate_5 = Panel("51")
z_coordinate_5 = Panel(panel)
construct_point_5 = ConstructPoint(XCoordinate=x_coordinate_5, YCoordinate=y_coordinate_5, ZCoordinate=z_coordinate_5)
# Comment: Creates a Sketch of the drawn curves on the grasshopper canvas
# 
# needs the plugin Metahopper
tl_point_2 = Point(construct_point_5)

# ---- group: Define Writing space / bottom right
x_coordinate_6 = Panel("713")
y_coordinate_6 = Panel("142")
z_coordinate_6 = Panel(panel)
construct_point_6 = ConstructPoint(XCoordinate=x_coordinate_6, YCoordinate=y_coordinate_6, ZCoordinate=z_coordinate_6)
br_point_2 = Point(construct_point_6)

# ---- group: Sketch from text / Create curves from text input
panel_2 = Panel(font)  # disabled
origin = Point(Point(0.007074401231, -0.02634070152, 0))  # disabled
textsize = Number(number)  # disabled
bold_2 = Boolean(bold)  # disabled
panel_3 = Panel(text_to_write)  # disabled
c_script = CSharpScript(face=panel_2, bold=bold_2, size=textsize, content=panel_3, pl=origin)  # -> out, A; inputs face: String, bold: Boolean, italics: Boolean, size: Double, content: String, pl: Plane; disabled
# ---------- c_script: C# ----------
    if(size == 0)
      size = 1;

    if(!string.IsNullOrEmpty(face) && size > 0 && !string.IsNullOrEmpty(content) &&
      pl.IsValid)
    {

      var te = RhinoDoc.ActiveDoc.Objects.AddText(content, pl, size, face, bold, italics);
      Rhino.DocObjects.TextObject txt = RhinoDoc.ActiveDoc.Objects.Find(te) as Rhino.DocObjects.TextObject;

      if(txt != null)
      {
        var tt = txt.Geometry as Rhino.Geometry.TextEntity;
        A = tt.Explode();
      }
      
      RhinoDoc.ActiveDoc.Objects.Delete(te, true);
    }
# ---------- end c_script ----------
curve = Curve(c_script.A)  # disabled

# ---- group: TCP Setting
length_from_flange = Slider(193, range=0..1000)
number_2 = Number(length_from_flange)

# ---- group: Robot Settings
move_height = Slider(13.592, range=0..50)
robot_speed = Slider(34, range=0..200)
robot_soft_radius = Slider(0.589, range=0..20)
text_to_polyline_tolerance = Slider(0.0348, range=0.0009..10)
number_3 = Number(move_height)
number_4 = Number(text_to_polyline_tolerance)
number_5 = Number(robot_speed)
number_6 = Number(robot_soft_radius)

# ---- group: Text plane direction towards robot base
text_plane_direction = ValueList({"None": 0, "Positive X": 1, "Positive Y": 2, "Negative X": 3, "Negative Y": 4}, selected="Positive X")

# ----
# Sketch Preview
anfangspose = Panel("""4
-117
-71
-79
90
0""")

# ---- group: Sketching Controls
# Enable
enable = BooleanToggle(False)  # disabled

# Reset
reset = Button()  # disabled

# ----
license = Panel("""                    GNU GENERAL PUBLIC LICENSE
                       Version 3, 29 June 2007

 Copyright (C) 2007 Free Software Foundation, Inc. <https://fsf.org/>
 Everyone is permitted to copy and distribute verbatim copies
 of this license document, but changing it is not allowed.

                            Preamble

  The GNU General Public License is a free, copyleft license for
software and other kinds of works.

  The licenses for most software and other practical works are designed
to take away your freedom to share and change the works.  By contrast,
the GNU General Public License is intended to guarantee your freedom to
share and change all versions of a program--to make sure it remains free
software for all its users.  We, the Free Software Foundation, use the
GNU General Public License for most of our software; it applies also to
any other work released this way by its authors.  You can apply it to
your programs, too.

  When we speak of free software, we are referring to freedom, not
price.  Our General Public Licenses are designed to make sure that you
have the freedom to distribute copies of free software (and charge for
them if you wish), that you receive source code or can get it if you
want it, that you can change the software or use pieces of it in new
free programs, and that you know you can do these things.

  To protect your rights, we need to prevent others from denying you
these rights or asking you to surrender the rights.  Therefore, you have
certain responsibilities if you distribute copies of the software, or if
you modify it: responsibilities to respect the freedom of others.

  For example, if you distribute copies of such a program, whether
gratis or for a fee, you must pass on to the recipients the same
freedoms that you received.  You must make sure that they, too, receive
or can get the source code.  And you must show them these terms so they
know their rights.

  Developers that use the GNU GPL protect your rights with two steps:
(1) assert copyright on the software, and (2) offer you this License
giving you legal permission to copy, distribute and/or modify it.

  For the developers' and authors' protection, the GPL clearly explains
that there is no warranty for this free software.  For both users' and
authors' sake, the GPL requires that modified versions be marked as
changed, so that their problems will not be attributed erroneously to
authors of previous versions.

  Some devices are designed to deny users access to install or run
modified versions of the software inside them, although the manufacturer
can do so.  This is fundamentally incompatible with the aim of
protecting users' freedom to change the software.  The systematic
pattern of such abuse occurs in the area of products for individuals to
use, which is precisely where it is most unacceptable.  Therefore, we
have designed this version of the GPL to prohibit the practice for those
products.  If such problems arise substantially in other domains, we
stand ready to extend this provision to those domains in future versions
of the GPL, as needed to protect the freedom of users.

  Finally, every program is threatened constantly by software patents.
States should not allow patents to restrict development and use of
software on general-purpose computers, but in those that do, we wish to
avoid the special danger that patents applied to a free program could
make it effectively proprietary.  To prevent this, the GPL assures that
patents cannot be used to render the program non-free.

  The precise terms and conditions for copying, distribution and
modification follow.

                       TERMS AND CONDITIONS

  0. Definitions.

  "This License" refers to version 3 of the GNU General Public License.

  "Copyright" also means copyright-like laws that apply to other kinds of
works, such as semiconductor masks.

  "The Program" refers to any copyrightable work licensed under this
License.  Each licensee is addressed as "you".  "Licensees" and
"recipients" may be individuals or organizations.

  To "modify" a work means to copy from or adapt all or part of the work
in a fashion requiring copyright permission, other than the making of an
exact copy.  The resulting work is called a "modified version" of the
earlier work or a work "based on" the earlier work.

  A "covered work" means either the unmodified Program or a work based
on the Program.

  To "propagate" a work means to do anything with it that, without
permission, would make you directly or secondarily liable for
infringement under applicable copyright law, except executing it on a
computer or modifying a private copy.  Propagation includes copying,
distribution (with or without modification), making available to the
public, and in some countries other activities as well.

  To "convey" a work means any kind of propagation that enables other
parties to make or receive copies.  Mere interaction with a user through
a computer network, with no transfer of a copy, is not conveying.

  An interactive user interface displays "Appropriate Legal Notices"
to the extent that it includes a convenient and prominently visible
feature that (1) displays an appropriate copyright notice, and (2)
tells the user that there is no warranty for the work (except to the
extent that warranties are provided), that licensees may convey the
work under this License, and how to view a copy of this License.  If
the interface presents a list of user commands or options, such as a
menu, a prominent item in the list meets this criterion.

  1. Source Code.

  The "source code" for a work means the preferred form of the work
for making modifications to it.  "Object code" means any non-source
form of a work.

  A "Standard Interface" means an interface that either is an official
standard defined by a recognized standards body, or, in the case of
interfaces specified for a particular programming language, one that
is widely used among developers working in that language.

  The "System Libraries" of an executable work include anything, other
than the work as a whole, that (a) is included in the normal form of
packaging a Major Component, but which is not part of that Major
Component, and (b) serves only to enable use of the work with that
Major Component, or to implement a Standard Interface for which an
implementation is available to the public in source code form.  A
"Major Component", in this context, means a major essential component
(kernel, window system, and so on) of the specific operating system
(if any) on which the executable work runs, or a compiler used to
produce the work, or an object code interpreter used to run it.

  The "Corresponding Source" for a work in object code form means all
the source code needed to generate, install, and (for an executable
work) run the object code and to modify the work, including scripts to
control those activities.  However, it does not include the work's
System Libraries, or general-purpose tools or generally available free
programs which are used unmodified in performing those activities but
which are not part of the work.  For example, Corresponding Source
includes interface definition files associated with source files for
the work, and the source code for shared libraries and dynamically
linked subprograms that the work is specifically designed to require,
such as by intimate data communication or control flow between those
subprograms and other parts of the work.

  The Corresponding Source need not include anything that users
can regenerate automatically from other parts of the Corresponding
Source.

  The Corresponding Source for a work in source code form is that
same work.

  2. Basic Permissions.

  All rights granted under this License are granted for the term of
copyright on the Program, and are irrevocable provided the stated
conditions are met.  This License explicitly affirms your unlimited
permission to run the unmodified Program.  The output from running a
covered work is covered by this License only if the output, given its
content, constitutes a covered work.  This License acknowledges your
rights of fair use or other equivalent, as provided by copyright law.

  You may make, run and propagate covered works that you do not
convey, without conditions so long as your license otherwise remains
in force.  You may convey covered works to others for the sole purpose
of having them make modifications exclusively for you, or provide you
with facilities for running those works, provided that you comply with
the terms of this License in conveying all material for which you do
not control copyright.  Those thus making or running the covered works
for you must do so exclusively on your behalf, under your direction
and control, on terms that prohibit them from making any copies of
your copyrighted material outside their relationship with you.

  Conveying under any other circumstances is permitted solely under
the conditions stated below.  Sublicensing is not allowed; section 10
makes it unnecessary.

  3. Protecting Users' Legal Rights From Anti-Circumvention Law.

  No covered work shall be deemed part of an effective technological
measure under any applicable law fulfilling obligations under article
11 of the WIPO copyright treaty adopted on 20 December 1996, or
similar laws prohibiting or restricting circumvention of such
measures.

  When you convey a covered work, you waive any legal power to forbid
circumvention of technological measures to the extent such circumvention
is effected by exercising rights under this License with respect to
the covered work, and you disclaim any intention to limit operation or
modification of the work as a means of enforcing, against the work's
users, your or third parties' legal rights to forbid circumvention of
technological measures.

  4. Conveying Verbatim Copies.

  You may convey verbatim copies of the Program's source code as you
receive it, in any medium, provided that you conspicuously and
appropriately publish on each copy an appropriate copyright notice;
keep intact all notices stating that this License and any
non-permissive terms added in accord with section 7 apply to the code;
keep intact all notices of the absence of any warranty; and give all
recipients a copy of this License along with the Program.

  You may charge any price or no price for each copy that you convey,
and you may offer support or warranty protection for a fee.

  5. Conveying Modified Source Versions.

  You may convey a work based on the Program, or the modifications to
produce it from the Program, in the form of source code under the
terms of section 4, provided that you also meet all of these conditions:

    a) The work must carry prominent notices stating that you modified
    it, and giving a relevant date.

    b) The work must carry prominent notices stating that it is
    released under this License and any conditions added under section
    7.  This requirement modifies the requirement in section 4 to
    "keep intact all notices".

    c) You must license the entire work, as a whole, under this
    License to anyone who comes into possession of a copy.  This
    License will therefore apply, along with any applicable section 7
    additional terms, to the whole of the work, and all its parts,
    regardless of how they are packaged.  This License gives no
    permission to license the work in any other way, but it does not
    invalidate such permission if you have separately received it.

    d) If the work has interactive user interfaces, each must display
    Appropriate Legal Notices; however, if the Program has interactive
    interfaces that do not display Appropriate Legal Notices, your
    work need not make them do so.

  A compilation of a covered work with other separate and independent
works, which are not by their nature extensions of the covered work,
and which are not combined with it such as to form a larger program,
in or on a volume of a storage or distribution medium, is called an
"aggregate" if the compilation and its resulting copyright are not
used to limit the access or legal rights of the compilation's users
beyond what the individual works permit.  Inclusion of a covered work
in an aggregate does not cause this License to apply to the other
parts of the aggregate.

  6. Conveying Non-Source Forms.

  You may convey a covered work in object code form under the terms
of sections 4 and 5, provided that you also convey the
machine-readable Corresponding Source under the terms of this License,
in one of these ways:

    a) Convey the object code in, or embodied in, a physical product
    (including a physical distribution medium), accompanied by the
    Corresponding Source fixed on a durable physical medium
    customarily used for software interchange.

    b) Convey the object code in, or embodied in, a physical product
    (including a physical distribution medium), accompanied by a
    written offer, valid for at least three years and valid for as
    long as you offer spare parts or customer support for that product
    model, to give anyone who possesses the object code either (1) a
    copy of the Corresponding Source for all the software in the
    product that is covered by this License, on a durable physical
    medium customarily used for software interchange, for a price no
    more than your reasonable cost of physically performing this
    conveying of source, or (2) access to copy the
    Corresponding Source from a network server at no charge.

    c) Convey individual copies of the object code with a copy of the
    written offer to provide the Corresponding Source.  This
    alternative is allowed only occasionally and noncommercially, and
    only if you received the object code with such an offer, in accord
    with subsection 6b.

    d) Convey the object code by offering access from a designated
    place (gratis or for a charge), and offer equivalent access to the
    Corresponding Source in the same way through the same place at no
    further charge.  You need not require recipients to copy the
    Corresponding Source along with the object code.  If the place to
    copy the object code is a network server, the Corresponding Source
    may be on a different server (operated by you or a third party)
    that supports equivalent copying facilities, provided you maintain
    clear directions next to the object code saying where to find the
    Corresponding Source.  Regardless of what server hosts the
    Corresponding Source, you remain obligated to ensure that it is
    available for as long as needed to satisfy these requirements.

    e) Convey the object code using peer-to-peer transmission, provided
    you inform other peers where the object code and Corresponding
    Source of the work are being offered to the general public at no
    charge under subsection 6d.

  A separable portion of the object code, whose source code is excluded
from the Corresponding Source as a System Library, need not be
included in conveying the object code work.

  A "User Product" is either (1) a "consumer product", which means any
tangible personal property which is normally used for personal, family,
or household purposes, or (2) anything designed or sold for incorporation
into a dwelling.  In determining whether a product is a consumer product,
doubtful cases shall be resolved in favor of coverage.  For a particular
product received by a particular user, "normally used" refers to a
typical or common use of that class of product, regardless of the status
of the particular user or of the way in which the particular user
actually uses, or expects or is expected to use, the product.  A product
is a consumer product regardless of whether the product has substantial
commercial, industrial or non-consumer uses, unless such uses represent
the only significant mode of use of the product.

  "Installation Information" for a User Product means any methods,
procedures, authorization keys, or other information required to install
and execute modified versions of a covered work in that User Product from
a modified version of its Corresponding Source.  The information must
suffice to ensure that the continued functioning of the modified object
code is in no case prevented or interfered with solely because
modification has been made.

  If you convey an object code work under this section in, or with, or
specifically for use in, a User Product, and the conveying occurs as
part of a transaction in which the right of possession and use of the
User Product is transferred to the recipient in perpetuity or for a
fixed term (regardless of how the transaction is characterized), the
Corresponding Source conveyed under this section must be accompanied
by the Installation Information.  But this requirement does not apply
if neither you nor any third party retains the ability to install
modified object code on the User Product (for example, the work has
been installed in ROM).

  The requirement to provide Installation Information does not include a
requirement to continue to provide support service, warranty, or updates
for a work that has been modified or installed by the recipient, or for
the User Product in which it has been modified or installed.  Access to a
network may be denied when the modification itself materially and
adversely affects the operation of the network or violates the rules and
protocols for communication across the network.

  Corresponding Source conveyed, and Installation Information provided,
in accord with this section must be in a format that is publicly
documented (and with an implementation available to the public in
source code form), and must require no special password or key for
unpacking, reading or copying.

  7. Additional Terms.

  "Additional permissions" are terms that supplement the terms of this
License by making exceptions from one or more of its conditions.
Additional permissions that are applicable to the entire Program shall
be treated as though they were included in this License, to the extent
that they are valid under applicable law.  If additional permissions
apply only to part of the Program, that part may be used separately
under those permissions, but the entire Program remains governed by
this License without regard to the additional permissions.

  When you convey a copy of a covered work, you may at your option
remove any additional permissions from that copy, or from any part of
it.  (Additional permissions may be written to require their own
removal in certain cases when you modify the work.)  You may place
additional permissions on material, added by you to a covered work,
for which you have or can give appropriate copyright permission.

  Notwithstanding any other provision of this License, for material you
add to a covered work, you may (if authorized by the copyright holders of
that material) supplement the terms of this License with terms:

    a) Disclaiming warranty or limiting liability differently from the
    terms of sections 15 and 16 of this License; or

    b) Requiring preservation of specified reasonable legal notices or
    author attributions in that material or in the Appropriate Legal
    Notices displayed by works containing it; or

    c) Prohibiting misrepresentation of the origin of that material, or
    requiring that modified versions of such material be marked in
    reasonable ways as different from the original version; or

    d) Limiting the use for publicity purposes of names of licensors or
    authors of the material; or

    e) Declining to grant rights under trademark law for use of some
    trade names, trademarks, or service marks; or

    f) Requiring indemnification of licensors and authors of that
    material by anyone who conveys the material (or modified versions of
    it) with contractual assumptions of liability to the recipient, for
    any liability that these contractual assumptions directly impose on
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""")

panel_4 = Panel("if(x=1,1,0)")  # disabled

# ---- group: Get Mouse position on the canvas
panel_5 = Panel(enable)  # disabled
mouse_event = MouseEvent(Start=panel_5)  # -> Line, Point, Button, Double, SPoint; disabled
boolean = Boolean(mouse_event.Button)  # disabled
evaluate = Evaluate(Expression=panel_4, x=mouse_event.Button)  # disabled
point = Panel(mouse_event.SPoint)  # disabled
point_2 = Panel(mouse_event.Point)  # disabled
mouse_pressed = Panel(boolean)  # disabled

# Comment: Uses the plugin interactiontools to monitor:
# - position of the cursor in the viewport
# - mouse pressed state
integer = Integer(evaluate)  # disabled
point_3 = Point(mouse_event.Point)  # disabled

# ----
radians = Radians(Degrees="90")
point_4 = Point(tl_point)
point_5 = Point(tr_point)
point_6 = Point(br_point)
list = ValueList({"Joint", "Linear"}, selected="Linear")

# ---- group: Programm export
export_button = Button()
txt_filename = Panel("20190425_Testing")

# ---- group: Export all commands to a .txt file
filename = Text(txt_filename)
boolean_2 = Boolean(export_button)

# ---- group: Upload to Robot
robot_ip_adress = Panel("192.168.137.2")
# Description: 2019-04-30
# Robot movements from Sketch in the Rhino viewport.
# 
# This definition uses the following plugins:
# interactool
# https://www.food4rhino.com/app/interactool
# Metahopper (optional)
# https://www.food4rhino.com/app/metahopper
# Machina
# Robots
# 
# 
# and the following scripts:
# 
# rec reset
# Written by Marios Tsiliakos
# 
# O_GetUsedComponents2 (optional)
# Written by Chris Hanley
upload = Button()
pause = Button()
play = Button()
boolean_3 = Boolean(upload)
boolean_4 = Boolean(pause)
boolean_5 = Boolean(play)

# ----
port = Panel("6100")
port_2 = Panel("7100")
udp_owl = UDPReceiver(Port=port, Pattern=0)  # -> Info, Data
udp_owl_2 = UDPReceiver(Port=port_2, Pattern=0)  # -> Info, Data
from_json = FromJSON(JSON=udp_owl.Data)
panel_6 = Panel(udp_owl.Info)
boolean_6 = Boolean(udp_owl_2.Data)
json_path = JSONPath(JObject=from_json, JSONPathQuery="$.polylines.*")
panel_7 = Panel(boolean_6)
from_json_2 = FromJSON(JSON=json_path)
json_path_2 = JSONPath(JObject=from_json_2, JSONPathQuery="$.points.*")
from_json_3 = FromJSON(JSON=json_path_2)
gate_or = GateOr(A=panel_7, B=boolean_3)
json_path_3 = JSONPath(JObject=from_json_3, JSONPathQuery="$.x")
json_path_4 = JSONPath(JObject=from_json_3, JSONPathQuery="$.y")
trim_tree = TrimTree(Tree=json_path_3, Depth=1)
trim_tree_2 = TrimTree(Tree=json_path_4, Depth=1)
negative = Negative(Value=trim_tree_2)
construct_point_7 = ConstructPoint(XCoordinate=trim_tree, YCoordinate=negative, ZCoordinate=0)
point_7 = Point(construct_point_7)

# ---- group: Create curve from points
point_8 = Point(point_7)
interpolate = Interpolate(Vertices=point_8, Degree=3, Periodic=False, KnotStyle=1)  # -> Curve, Length, Domain
curve_2 = Curve(interpolate.Curve)

# ----
rotate = Rotate(Geometry=curve_2, Angle=radians, Plane=PlaneXY(0, 0, 0))  # -> Geometry, Transform

# ---- group: Robot Simulation
simulation_control = ControlKnob(Decimals=6, Limit=True, Maximum=1, Minimum=0, Range=0.1, Value=0.724295)
trail_length = Slider(4201, range=0..10000)

# ---- group: Geometry to verify
flat_sketch = Curve(curve_2)
flat_sketch_2 = Curve(curve)

# ---- group: Point recording
# Comment: Records the points of the mouse position as well as a boolean value (Integer 0 or 1) if the mouse is pressed. This boolean value is used to later group the points into curves that correspond with a mouseclick.
# 
# Also contains a script to reset the recorders. The script is by Marios Tsiliakos taken from:
# https://www.grasshopper3d.com/forum/topics/data-recorder-enable-record-boolean-input
reset_2 = Boolean(reset)  # disabled
point_9 = Point(point_3)  # disabled
integer_2 = Integer(integer)  # disabled

cull_pattern = CullPattern(List=point_9, CullPattern=integer_2)  # disabled
c_rec_reset = CSharpScript(clean=reset_2)  # inputs clean: Boolean, pause: Boolean; disabled
# ---------- c_rec_reset: C# usings ----------
using System.IO;
using System.Linq;
using System.Data;
using System.Drawing;
using System.Reflection;
using System.Windows.Forms;
using System.Xml;
using System.Xml.Linq;
using System.Runtime.InteropServices;

using Rhino.DocObjects;
using Rhino.Collections;
using GH_IO;
using GH_IO.Serialization;
# ---------- c_rec_reset: C# ----------
    //iterate through all the objects of the grashopper document;
    foreach (object obj in GrasshopperDocument.Objects)
    {
      //chek only for the GH_DataRecorder components
      if (obj is Grasshopper.Kernel.Special.GH_DataRecorder)
      {

        //cast the obj into GH_DataRecorder wrapper class to be able to access its methods
        Grasshopper.Kernel.Special.GH_DataRecorder dataDestroy = (Grasshopper.Kernel.Special.GH_DataRecorder) obj;
        //store the recording state of the component in a temp boolean
        bool recState = dataDestroy.RecordData;

        if(clean)
        {
          //clean the data and reset the recorder component
          dataDestroy.DestroyRecordedData();
          dataDestroy.ExpireSolution(true);
        }
        if(pause)
        {
          dataDestroy.RecordData = !recState;
          recState = dataDestroy.RecordData;
        }
      }
    }
# ---------- end c_rec_reset ----------
point_10 = Point(cull_pattern)  # disabled
data_recorder = DataRecorder(point_10, DataLimit=-10, RecordData=True)  # disabled
data_recorder_2 = DataRecorder(integer_2, DataLimit=-10, RecordData=True)  # disabled

point_11 = Point(data_recorder)  # disabled
integer_3 = Integer(data_recorder_2)  # disabled

# ---- group: get indices for point grouping
# Comment: Turns the list of boolean values that determine weather the mouse is clicked into a list of indices.
integer_4 = Integer(integer_3)  # disabled

list_length = ListLength(List=integer_4)  # disabled
series = Series(Start=0, Step=1, Count=list_length)  # disabled
cull_pattern_2 = CullPattern(List=series, CullPattern=integer_4)  # disabled

integer_5 = Integer(cull_pattern_2)  # disabled

# ---- group: Point list split indices
# Comment: Gets the indices at which to split the list of points to create individual curves instead of joining all points.
integer_6 = Integer(integer_5)  # disabled

list_length_2 = ListLength(List=integer_6)  # disabled
shift_list = ShiftList(List=integer_6, Shift=1, Wrap=True)  # disabled
panel_8 = Panel("1")  # disabled
subtraction_2 = Subtraction(A=shift_list, B=integer_6)  # disabled
subtraction_3 = Subtraction(A=list_length_2, B=panel_8)  # disabled
panel_9 = Panel("1")  # disabled
equality = Equality(FirstNumber=subtraction_2, SecondNumber=panel_9)  # -> Equality, Inequality; disabled
series_2 = Series(Start=0, Step=1, Count=list_length_2)  # disabled
cull_pattern_3 = CullPattern(List=series_2, CullPattern=equality.Inequality)  # disabled

integer_7 = Integer(cull_pattern_3)  # disabled

# ---- group: Create writing area
# Comment: Creates the drawing area from coordinates
tr_point_3 = Point(point_5)
br_point_3 = Point(point_6)
tl_point_3 = Point(point_4)

plane_3pt = Plane3Pt(PointA=tl_point_3, PointB=tr_point_3, PointC=br_point_3)
rectangle_3pt = Rectangle3Pt(PointA=tl_point_3, PointB=tr_point_3, PointC=br_point_3)  # -> Rectangle, Length
plane = Plane(plane_3pt)
flip_plane = FlipPlane(Plane=plane, ReverseX=Toggle(False), ReverseY=Toggle(False), SwapAxes=Toggle(False))
flip_plane_2 = FlipPlane(Plane=plane, ReverseX=Toggle(False), ReverseY=Toggle(True), SwapAxes=Toggle(False))

writing_area_rectangle = Rectangle(rectangle_3pt.Rectangle)
writing_plane = Plane(flip_plane)
text_plane = Plane(flip_plane_2)

# ---- group: Geometry to verify (continued)
writing_surface = Rectangle(writing_area_rectangle)

# ---- group: Create writing area
# Comment: Creates the drawing area from coordinates
tr_point_4 = Point(tr_point_2)
br_point_4 = Point(br_point_2)
tl_point_4 = Point(tl_point_2)

plane_3pt_2 = Plane3Pt(PointA=tl_point_4, PointB=tr_point_4, PointC=br_point_4)
rectangle_3pt_2 = Rectangle3Pt(PointA=tl_point_4, PointB=tr_point_4, PointC=br_point_4)  # -> Rectangle, Length
plane_2 = Plane(plane_3pt_2)
flip_plane_3 = FlipPlane(Plane=plane_2, ReverseX=Toggle(False), ReverseY=Toggle(False), SwapAxes=Toggle(False))
flip_plane_4 = FlipPlane(Plane=plane_2, ReverseX=Toggle(False), ReverseY=Toggle(True), SwapAxes=Toggle(False))

writing_area_rectangle_2 = Rectangle(rectangle_3pt_2.Rectangle)
writing_plane_2 = Plane(flip_plane_3)
text_plane_2 = Plane(flip_plane_4)

# ----
curve_3 = Curve(flatten(rotate.Geometry))

bounding_box = BoundingBox(Content=curve_3, Plane=PlaneXY(0, 0, 0), UnionBox=True)  # -> Box, Box_2
rectangle = Rectangle(bounding_box.Box)
rectangle_2 = Rectangle(bounding_box.Box_2)
control_points = ControlPoints(Curve=rectangle)  # -> Points, Weights, Knots
list_item = ListItem(List=control_points.Points, Index=3, Wrap=True)
point_12 = Point(list_item)
orient = Orient(Geometry=curve_3, Source=point_12, Target=PlaneXY(0, 0, 0))  # -> Geometry, Transform

rectangle_3 = Rectangle(rectangle)
curve_4 = Curve(orient.Geometry)

# ---- group: Split points into sublists
# Comment: Splits the list of points into sublists that correspond with the seperate mouse clicks.
integer_8 = Integer(integer_7)  # disabled
point_13 = Point(point_11)  # disabled

panel_10 = Panel("1")  # disabled
addition = Addition(A=integer_8, B=panel_10)  # disabled
panel_11 = Panel("0")  # disabled
list_length_3 = ListLength(List=point_13)  # disabled
merge = Merge(Data1=flatten(panel_11), Data2=flatten(addition), Data3=flatten(list_length_3))  # disabled
consecutive_domains = ConsecutiveDomains(Numbers=flatten(merge), Additive=False)  # disabled
deconstruct_domain = DeconstructDomain(Domain=consecutive_domains)  # -> Start, End; disabled
subtraction_4 = Subtraction(A=deconstruct_domain.End, B=deconstruct_domain.Start)  # disabled
partition_list = PartitionList(List=point_13, Size=subtraction_4)  # disabled

point_14 = Point(partition_list)  # disabled

# ---- group: Resize Sketch to fit into Writing surface
# Comment: Fits the drawn curves into the drawing rectangle
writing_surface_rectangle = Rectangle(flatten(writing_area_rectangle))
bounding_box_rectangle = Rectangle(flatten(rectangle_3))
curve_5 = Curve(curve_4)

decon_rectangle = DeconstuctRectangle(Rectangle=simplify(bounding_box_rectangle))  # -> BasePlane, XInterval, YInterval
decont_rectangle = DeconstuctRectangle(Rectangle=writing_surface_rectangle)  # -> BasePlane, XInterval, YInterval
dec_domain = DeconstructDomain(Domain=decon_rectangle.XInterval)  # -> Start, End
dec_domain_2 = DeconstructDomain(Domain=decon_rectangle.YInterval)  # -> Start, End
dec_domain_3 = DeconstructDomain(Domain=decont_rectangle.XInterval)  # -> Start, End
dec_domain_4 = DeconstructDomain(Domain=decont_rectangle.YInterval)  # -> Start, End
subtraction_5 = Subtraction(A=dec_domain_2.End, B=dec_domain_2.Start)
subtraction_6 = Subtraction(A=dec_domain_4.End, B=dec_domain_4.Start)
subtraction_7 = Subtraction(A=dec_domain.End, B=dec_domain.Start)
subtraction_8 = Subtraction(A=dec_domain_3.End, B=dec_domain_3.Start)
X = Number(subtraction_7)
X_2 = Number(subtraction_8)
Y = Number(subtraction_5)
Y_2 = Number(subtraction_6)
division = Division(A=X_2, B=X)
division_2 = Division(A=Y_2, B=Y)
evaluate_2 = Evaluate(Expression="If(x>y,y,x)", x=division, y=division_2)
scale = Scale(Geometry=curve_5, Center=Point(0, 0, 0), Factor=evaluate_2)  # -> Geometry, Transform

curve_6 = Curve(scale.Geometry)

# ---- group: Orient flat text to writing plane
curve_7 = Curve(curve_6)
plane_3 = Plane(text_plane)
orient_2 = Orient(Geometry=curve_7, Source=PlaneXY(0, 0, 0), Target=plane_3)  # -> Geometry, Transform
curve_8 = Curve(orient_2.Geometry)

curve_9 = Curve(curve_6)
plane_4 = Plane(text_plane_2)
orient_3 = Orient(Geometry=curve_9, Source=PlaneXY(0, 0, 0), Target=plane_4)  # -> Geometry, Transform
curve_10 = Curve(orient_3.Geometry)

# ---- group: Create preview sketch on GH-canvas
# Comment: Creates a sketch on the Grasshopper canvas which displays the curves.
# Usefurl when using multiple monitors.
# Uses the plugin Metahopper.
curve_11 = Curve(flatten(curve_8))
rectangle_4 = Rectangle(writing_area_rectangle)

get_groups = GetGroups()  # -> Groups, GroupStyles, Nickname, Color
member_index = MemberIndex(Set=get_groups.Nickname, Member="sketch")  # -> Index, Count
list_item_2 = ListItem(List=get_groups.Groups, Index=member_index.Index, Wrap=True)
merge_2 = Merge(Data1=simplify(flatten(rectangle_4)), Data2=simplify(flatten(curve_11)))
obj_in_group = GetObjectsInGroup(Group=list_item_2)
set_sketch = SetSketch(Sketch=obj_in_group, SketchShapes=flatten(merge_2))

# ---- group: Differentiate polylines from single points
# Comment: Creates two trees of points:
# Single points (created by a short click on the viewport)
# Multiple points (created by a long press on the viewport)
point_15 = Point(simplify(point_14))  # disabled

list_length_4 = ListLength(List=point_15)  # -> flatten(Length); disabled
panel_12 = Panel("1")  # disabled
equality_2 = Equality(FirstNumber=list_length_4, SecondNumber=panel_12)  # -> flatten(Equality), Inequality; disabled
list_length_5 = ListLength(List=list_length_4)  # -> flatten(Length); disabled
series_3 = Series(Start=0, Step=1, Count=list_length_5)  # disabled
dispatch = Dispatch(List=series_3, DispatchPattern=equality_2.Equality)  # -> ListA, ListB; disabled
tree_branch = TreeBranch(Tree=simplify(point_15), Path=dispatch.ListA, MaintainPaths=False)  # disabled
tree_branch_2 = TreeBranch(Tree=simplify(point_15), Path=dispatch.ListB, MaintainPaths=False)  # disabled
panel_13 = Panel("true")  # disabled
clean_tree = CleanTree(RemoveNulls=panel_13, RemoveInvalid=panel_13, RemoveEmpty=panel_13, Tree=tree_branch_2)  # -> simplify(Tree); disabled

# ----
# Comment: This Stream FIlter is only there make the function work if there is only one line in the sketch. Without it, the first line is not found because the "Tree branch" component doesnt work with only one list.
panel_14 = Panel("If(x=1,0,1)")  # disabled
tree_statistics = TreeStatistics(Tree=point_15)  # -> Paths, Length, Count; disabled
evaluate_3 = Evaluate(Expression=panel_14, x=tree_statistics.Count)  # disabled
stream_filter = StreamFilter(Gate=evaluate_3, Stream0=point_15, Stream1=clean_tree)  # disabled

# ---- group: Differentiate polylines from single points (continued)
multiple_points = Point(stream_filter)  # disabled
single_points = Point(tree_branch)  # disabled

# ---- group: Create planes from curves
entwine = Entwine(Branch00=curve_8, Branch01=curve_10, FlattenInputs=True)
writing_plane_3 = Plane(writing_plane)
curve_12 = Curve(curve_8)
number_7 = Number(number_4)

curve_to_polyline = CurveToPolyline(Curve=curve_12, ToleranceDistance=number_7, ToleranceAngle=0)  # -> Polyline, Segments
dcnstrct_plane = DeconstructPlane(Plane=writing_plane_3)  # -> Origin, XAxis, YAxis, ZAxis
explode = Explode(Curve=curve_to_polyline.Polyline, Recursive=True)  # -> Segments, Vertices
plane_normal = PlaneNormal(Origin=explode.Vertices, ZAxis=dcnstrct_plane.ZAxis)

writing_plane_z_vector = Vector(dcnstrct_plane.ZAxis)
text_planes = Plane(plane_normal)
text_curves = Curve(curve_to_polyline.Polyline)

# ---- group: Geometry to verify (continued)
sketch_in_position = Curve(text_curves)
text_planes_2 = Plane(text_planes)

# ---- group: Align Planes with base
plane_5 = Plane(text_planes)

xy_plane = XYPlane(Origin=Point(0, 0, 0))
vector_2pt = Vector2Pt(PointA=plane_5, PointB=xy_plane, Unitize="true")  # -> Vector, Length
align_plane = AlignPlane(Plane=plane_5, Direction=vector_2pt.Vector)  # -> Plane, Angle
flip_plane_5 = FlipPlane(Plane=align_plane.Plane, ReverseX="false", ReverseY="true", SwapAxes="true")
flip_plane_6 = FlipPlane(Plane=align_plane.Plane, ReverseX="true", ReverseY="true", SwapAxes="false")
flip_plane_7 = FlipPlane(Plane=align_plane.Plane, ReverseX="true", ReverseY="false", SwapAxes="true")

plane_x = Plane(flip_plane_6)
plane_x_2 = Plane(align_plane.Plane)
plane_y = Plane(flip_plane_5)
plane_y_2 = Plane(flip_plane_7)

# ----
integer_9 = Integer(text_plane_direction)
plane_6 = Plane(text_planes)
plane_7 = Plane(plane_x_2)
plane_8 = Plane(plane_y)
plane_9 = Plane(plane_x)
plane_10 = Plane(plane_y_2)
stream_filter_2 = StreamFilter(Gate=integer_9, Stream0=plane_6, Stream1=plane_7, Stream2=plane_8, Stream3=plane_9, Stream4=plane_10)
plane_11 = Plane(stream_filter_2)

# ---- group: Show plane axi
plane_12 = Plane(plane_11)
plane_axis_viewer = PlaneAxisViewer(plane=plane_12, length=Slider(21.426, range=0..30))

# ---- group: Inferior method of creating curves from points
point_16 = Point(multiple_points)  # disabled

polyline = PolyLine(Vertices=point_16, Closed=False)  # disabled
number_slider = Slider(1.1, range=0..10)  # disabled
reduce = Reduce(Polyline=polyline, Tolerance=number_slider)  # -> Polyline, Reduction; disabled
number_slider_2 = Slider(3, range=0..5)  # disabled
control_points_2 = ControlPoints(Curve=reduce.Polyline)  # -> Points, Weights, Knots; disabled
interpolate_2 = Interpolate(Vertices=control_points_2.Points, Degree=number_slider_2, Periodic=False, KnotStyle=1)  # -> Curve, Length, Domain; disabled

curve_13 = Curve(interpolate_2.Curve)  # disabled

# ---- group: Create Text Planes and offset Planes
text_planes_3 = Plane(plane_11)
first_and_last_list_index = Panel("""0
-1""")

# ---- group: Create Text Planes and offset Planes / Create offset Planes for non-writing moves
writing_plane_z_vector_2 = Vector(writing_plane_z_vector)
non_writing_height = Number(number_3)
amplitude = Amplitude(Vector=writing_plane_z_vector_2, Amplitude=expr("x*-1", non_writing_height))
list_item_3 = ListItem(List=text_planes_3, Index=first_and_last_list_index, Wrap=True)
move = Move(Geometry=list_item_3, Motion=amplitude)  # -> Geometry, Transform

# ---- group: Create Text Planes and offset Planes (continued)
insert_items = InsertItems(List=text_planes_3, Item=move.Geometry, Indices=first_and_last_list_index, Wrap=True)
trim_tree_3 = TrimTree(Tree=insert_items, Depth=2)
text_offset_planes = Plane(trim_tree_3)
offset_plane = Plane(move.Geometry)

# ---- group: Insert Approach points
writing_plane_z_vector_3 = Vector(writing_plane_z_vector)
non_writing_height_2 = Number(number_3)
number_slider_3 = Slider(6.525, range=0..10)
text_planes_4 = Plane(text_offset_planes)
first_and_last_list_index_2 = Panel("""0
-1""")

# ---- group: Insert Approach points / Create offset Planes for non-writing moves
multiplication = Multiplication(A=non_writing_height_2, B=number_slider_3)
amplitude_2 = Amplitude(Vector=writing_plane_z_vector_3, Amplitude=expr("x*-1", multiplication))
list_item_4 = ListItem(List=text_planes_4, Index=first_and_last_list_index_2, Wrap=True)
move_2 = Move(Geometry=list_item_4, Motion=amplitude_2)  # -> Geometry, Transform

# ---- group: Insert Approach points (continued)
insert_items_2 = InsertItems(List=text_planes_4, Item=move_2.Geometry, Indices=first_and_last_list_index_2, Wrap=True)
trim_tree_4 = TrimTree(Tree=insert_items_2, Depth=2)
text_offset_planes_2 = Plane(trim_tree_4)
offset_plane_2 = Plane(move_2.Geometry)

# ---- group: Create Pen Holder TCP and Mesh
number_8 = Number(number_2)

pen_thickness = Slider(5.3, range=0..100)
pen_sharpness = Slider(15.94, range=0..50)
point_17 = ConstructPoint(XCoordinate=0, YCoordinate=0, ZCoordinate=number_8)
number_9 = Number(pen_thickness)
number_10 = Number(pen_sharpness)
pen_holder_mesh = PenHolderMesh(number_3=number_9, number=number_8, number_2=number_10)
xy_plane_2 = XYPlane(Origin=point_17)
plane_13 = Plane(xy_plane_2)
mesh = Mesh(pen_holder_mesh)
create_tool = CreateTool(Name="DefaultGHTool", TCP=plane_13, Weight=0, Mesh=mesh)  # -> Tool, TCP

tool_parameter = ToolParameter(create_tool.Tool)

# ---- group: Visualise all movements
number_11 = Number(number_6)
point_18 = Point(text_offset_planes)

polyline_2 = PolyLine(Vertices=flatten(point_18), Closed=False)
fillet = Fillet(Curve=polyline_2, Radius=number_11)

movement_lines = Curve(fillet)

# ---- group: Geometry to verify (continued)
movement_lines_2 = Curve(movement_lines)

# ---- group: Create Robot Program
list_2 = ValueList({"Bartlett-IRB120", "Bartlett-IRB1600", "Bartlett-KR6", "Bartlett-KR60", "Bartlett-UR10", "BURG Halle-UR5", "BURG Halle-UR5 on table", "KULeuven-IRB120", "KULeuven-UR5", "KULeuven-UR10"}, selected="BURG Halle-UR5")
speed = Number(number_5)
plane_14 = Plane(text_offset_planes_2)
zone_soft_radius = Number(number_6)

# ----
speed_parameter = SpeedParameter(speed)

# ---- group: Create Robot Program
radians_2 = Radians(Degrees=anfangspose)
load_robot_system = LoadRobotSystem(Name=list_2, Base=PlaneXY(0, 0, 0))
create_target = CreateTarget(
    Plane=flatten(plane_14),
    Motion=list,
    Tool=tool_parameter,
    Speed=speed_parameter,
    Zone=zone_soft_radius,
    IsCartesian=True)
text_join = TextJoin(Text=radians_2, Join=",")
create_target_2 = CreateTarget(Joints=text_join, Tool=tool_parameter, Speed=speed_parameter, Zone=zone_soft_radius, IsCartesian=False)
merge_3 = Merge(Data1=create_target_2, Data2=create_target, Data3=create_target_2)
create_program = CreateProgram(Name="DefaultProgram", RobotSystem=load_robot_system, Targets1=merge_3, StepSize=1)  # -> Program, Code, Duration, Warnings, Errors

program_parameter = ProgramParameter(create_program.Program)
number_12 = Number(create_program.Duration)
text = Text(create_program.Code)
text_2 = Text(create_program.Warnings)
text_3 = Text(create_program.Errors)

# ---- group: Program Code and Errors
# Robot copy drawing v_2.0.0
# Created by Robin Godwyll
# BURG Halle University of Art and Design Germany
# Robot Lab Residency Spring 2019
program = Panel(program_parameter)
program_code = Panel(text)
warnings = Panel(text_2)
# TO DO: Rotieren um an den touchscrreen angepasst zu sein
# Point scan geschwindigkeit erhöhen
errors = Panel(text_3)

# ---- group: Export all commands to a .txt file (continued)
robot_program = Data(text)
program_code_2 = Panel(robot_program)
txtwrite = PythonScript(Data=program_code_2, Name=filename, Write=boolean_2, Reset=Toggle(False))  # inputs Data: list, Write: Boolean, Reset: Boolean
# ---------- txtwrite: Python ----------
import os
from scriptcontext import sticky as st

# Add a counter variable to sticky
if "count" not in st or Reset:
    st["count"] = 0
    
if Write:
    
    # Use the ghenv variable to get current GH file path
    filePath = ghenv.LocalScope.ghdoc.Path
    fileName = ghenv.LocalScope.ghdoc.Name
    filePath = filePath.replace(".gh","*")
    filePath = filePath.replace(fileName,"")
    
    # Add file name, count and extension
    filePath = os.path.join(filePath,Name + "_" + str(st["count"]) + ".txt")
    
    # Open file
    fileWrite = open(filePath,"w")
    
    # Write text data to file
    for line in Data:
        fileWrite.write(line + "\n")
        
    # Close file
    fileWrite.close()
    
    # Increment count
    st["count"] += 1
# ---------- end txtwrite ----------

# ----
ip_adress = Text(robot_ip_adress)
boolean_7 = Boolean(boolean_5)
boolean_8 = Boolean(gate_or)
boolean_9 = Boolean(boolean_4)
remote_connection = RemoteConnection(Program=program_parameter, IP=ip_adress, Upload=boolean_8, Play=boolean_7, Pause=boolean_9)  # disabled
text_4 = Text(remote_connection)

# ---- group: Upload to Robot (continued)
log = Panel(text_4)

# ---- group: Length of the program
list_length_6 = ListLength(List=text)
commands = Panel(list_length_6)

# ---- group: Programm export (continued)
commands_2 = Panel(commands)

# ---- group: Robot Simulation
number_13 = Number(simulation_control)
number_14 = Number(trail_length)

program_simulation = ProgramSimulation(Program=program_parameter, Time=number_13, Normalized=True)  # -> SystemMeshes, JointRotations, Plane, Index, Time, Program, Errors
check_collisions = CheckCollisions(
    Program=program_simulation.Program,
    FirstSet=7,
    SecondSet=4,
    EnvironmentPlane=-1,
    LinearStepSize=100,
    AngularStepSize=0.7853981634)  # -> CollisionFound, TargetIndex, CollidedMeshes
simple_trail = SimpleTrail(Program=program_simulation.Program, Length=number_14, MechanicalGroup=0)

collisions = Panel(check_collisions.CollisionFound)
colliding_meshes_mesh = Mesh(check_collisions.CollidedMeshes)
mesh_2 = Mesh(program_simulation.SystemMeshes)
curve_14 = Curve(simple_trail)

simulation_robot_trail = Curve(curve_14)
collisions_2 = Panel(collisions)
simulatied_robot_mesh = Mesh(mesh_2)

# ==== cluster PlaneAxisViewer
plane = ClusterInput()
panel = Panel("""Red
Green
Blue""")
length = ClusterInput()  # Size of the vector lines to display
plane_2 = Plane(graft(plane))
colour = Colour(panel)
deconstruct_plane = DeconstructPlane(Plane=plane_2)  # -> Origin, XAxis, YAxis, ZAxis
merge = Merge(Data1=deconstruct_plane.XAxis, Data2=deconstruct_plane.YAxis, Data3=deconstruct_plane.ZAxis)
multiplication = Multiplication(A=length, B=Slider(1.14, range=1..2))
amplitude = Amplitude(Vector=merge, Amplitude=length)
amplitude_2 = Amplitude(Vector=merge, Amplitude=multiplication)
move = Move(Geometry=deconstruct_plane.Origin, Motion=amplitude_2)  # -> Geometry, Transform
panel_2 = Panel("""X
Y
Z""")
text_tag = TextTag(Location=move.Geometry, Text=panel_2, Colour=colour)
vector_display_ex = VectorDisplayEx(Point=deconstruct_plane.Origin, Vector=amplitude, Colour=colour, Width=Slider(3.9, range=0..10))

# ==== cluster PenHolderMesh
number = ClusterInput()
number_2 = ClusterInput()
number_3 = ClusterInput()
number_4 = Number(number)
number_5 = Number(number_2)
number_6 = Number(number_3)
subtraction = Subtraction(A=number_4, B=number_5)
unit_z = UnitZ(Factor=subtraction)
unit_z_2 = UnitZ(Factor=number_4)
circle = Circle(Plane=PlaneXY(0, 0, 0), Radius=number_6)
extrude = Extrude(Base=circle, Direction=unit_z)
construct_point = ConstructPoint(XCoordinate=0, YCoordinate=0, ZCoordinate=unit_z_2)
move = Move(Geometry=circle, Motion=unit_z)  # -> Geometry, Transform
extrude_point = ExtrudePoint(Base=move.Geometry, Point=construct_point)
merge = Merge(Data1=extrude_point, Data2=extrude)
mesh_brep = MeshBrep(
    Brep=merge,
    Settings={GridMaxCount=0, GridMinCount=16, JaggedSeams=False, MaxEdgeLength=0, MinEdgeLength=0.0001, MinTolerance=0, Refine=True, RefineAngle=0, RelativeTolerance=0.65, SimplePlanes=True, Tolerance=0})
brep = Brep([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])
mesh = Mesh(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)
merge_2 = Merge(Data1=mesh, Data2=mesh_brep)
mesh_join = MeshJoin(Meshes=merge_2)
mesh_2 = Mesh(mesh_join)
mesh_3 = ClusterOutput(mesh_2)
